# Grasshopper definition YuheNiu_CellPhoneStand.gh (Grasshopper 1.0.7)
# plug-ins: Human, Kangaroo2 Components

# ----
# PHONE VARIABLE
phone_width_mm = Slider(81, range=0..300)
phone_thickness = Slider(13, range=0..300)
phone_tolerance_mm = Slider(1, range=0..2)
phone_length_mm = Slider(161, range=0..300)
phone_corner_radius_mm = Slider(5, range=0..300)
num_phone_width = Number(phone_width_mm)
num_phone_length = Number(phone_length_mm)
num_phone_corner_radius = Number(phone_corner_radius_mm)
num_phone_thickness = Number(phone_thickness)
num_phone_fit_tolerance = Number(phone_tolerance_mm)

notes = Panel("table")
# notes: let us make a simple model our phone.
# notes: let us construct an origin point for the cell phone.
notes_2 = Panel("phone body")

# ---- group: Get System Type, Get File Path, Set Material Texture
# notes: The file for the desk texture image includes the word "desk"
system_id = GhPythonScript()  # -> out, OS
# ---------- system_id: Python ----------
__author__ = "tj"
__version__ = "2023.08.28"

import rhinoscriptsyntax as rs
import platform

system_name = platform.system()

if system_name == "Windows":
    OS = "Windows PC"
elif system_name == "Darwin":
    OS = "Mac OS"
elif system_name == "Linux":
    OS = "Linux"
else:
    OS = "Unknown Operating System"
# ---------- end system_id ----------
panel = Panel(system_id.OS)
activedoc_path = Panel("C:\Users\24854\Desktop\TDF\week2\CellPhoneStand_Model_233008\CellPhoneStand_all")
image_filetypes = Panel("""*.png 
*.jpg 
*.tif""")
eval = Evaluate(F="if(OS=\"Windows PC\", 0,1)", OS=panel)
filter = StreamFilter(Gate=eval, Stream0="\", Stream1="/")
directory_for_images = Text(activedoc_path)
filetype_filters = Text(image_filetypes)
filter_2 = StreamFilter(Gate=eval, Stream0="studentknitting_alpha.tif", Stream1="studentknitting_alpha_mac.tif")
dir = DirectoryContents(FolderPath=directory_for_images, Filter=filetype_filters, IncludeSubfolders=False)  # -> FilePaths, FileNames
panel_2 = Panel(directory_for_images)
panel_3 = Panel(filter)
panel_4 = Panel(filter_2)
image_file_paths = Text(flatten(dir.FilePaths))
concat = Concatenate(FragmentA=panel_2, FragmentB=panel_3)
panel_5 = Panel(image_file_paths)
concat_2 = Concatenate(FragmentA=concat, FragmentB="greyFloor.tif")
concat_3 = Concatenate(FragmentA=concat, FragmentB="studentknitting.tif")
concat_4 = Concatenate(FragmentA=concat, FragmentB=panel_4)
concat_5 = Concatenate(FragmentA=concat, FragmentB="deskTile.tif")
panel_6 = Panel(concat_2)
panel_7 = Panel(concat_3)
panel_8 = Panel(concat_5)
panel_9 = Panel(concat_4)

# ----
table_location_x_coordinate = Slider(0, range=0..300)
table_location_y_coordinate = Slider(0, range=0..300)
table_location_z_coordinate = Slider(0, range=0..300)
phone_location_x_coordinate = Slider(0, range=0..300)
table_width_mm = Slider(1000, range=0..12000)
phone_location_y_coordinate = Slider(0, range=0..300)
table_length_mm = Slider(1000, range=0..12000)
phone_location_z_coordinate = Slider(0, range=0..300)
table_height_mm = Slider(800, range=0..12000)
# notes: let us define the screen as an offset from the outside edge of the device
notes_3 = Panel("phone screen")
phone_screen_offset_from_edge_mm = Slider(4, range=0..300)
camera35mmlenslength = Slider(24, range=18..80)
# notes: let us construct an origin point for the cell phone camera relative to the origin point of the phone.
notes_4 = Panel("phone camera lens")
# notes: let us construct a representation of the field of view for the camera.
phone_lens_view_depth = Slider(3000, range=0..3000)
phone_lens_location_x_coordinate = Slider(0, range=0..300)
phone_lens_location_y_coordinate = Slider(150, range=0..300)
phone_lens_location_z_coordinate = Slider(13, range=0..300)
phone_lens_rim_offset = Slider(3, range=0..300)
phone_lens_radius = Slider(5, range=0..25)
# notes: phone camera view frustum
phone_lens_thickness = Slider(0.5, range=0..2)
num_table_length = Number(table_length_mm)
num_table_width = Number(table_width_mm)
num_table_height = Number(table_height_mm)
pt = ConstructPoint(
    XCoordinate=table_location_x_coordinate,
    YCoordinate=table_location_y_coordinate,
    ZCoordinate=table_location_z_coordinate)
# notes: This is a point that will help us conceptually connect the virtual world to the physical world.
pt_phone_origin = ConstructPoint(
    XCoordinate=phone_location_x_coordinate,
    YCoordinate=phone_location_y_coordinate,
    ZCoordinate=phone_location_z_coordinate)
num_camera35mmlenslength = Number(camera35mmlenslength)
pt_table_origin = Point(pt)
num_screen_offset_from_edge = Number(phone_screen_offset_from_edge_mm)
vec_lens_location = VectorXYZ(
    XComponent=phone_lens_location_x_coordinate,
    YComponent=phone_lens_location_y_coordinate,
    ZComponent=phone_lens_location_z_coordinate)  # -> Vector, Length
cluster = Cluster(num=num_table_length)
cluster_2 = Cluster(num=num_table_width)
xy = XYPlane(Origin=pt_table_origin)
# notes: right click on the grey box allows me to name this element.
pt_phone_origin_2 = Point(pt_phone_origin)
domain_table_length = Domain(cluster)
domain_table_width = Domain(cluster_2)
cluster_3 = Cluster_3(num_camera35mmlenslength=num_camera35mmlenslength)
division = Division(A=num_phone_width, B="2.0")
domain_table_width_2 = Panel(domain_table_width)
domain_table_length_2 = Panel(domain_table_length)
pln_table = Plane(xy)
# notes: a reference plane whose origin is that point
xy_2 = XYPlane(Origin=pt_phone_origin_2)
neg = Negative(Value=division)
panel_10 = Panel(division)
neg_2 = Negative(Value=num_screen_offset_from_edge)
num_fov = Number(cluster_3)
dom = ConstructDomain(DomainStart=division, DomainEnd=neg)
pln_phone_origin = Plane(xy_2)
pln_phone_origin_2 = Plane(pln_phone_origin)
move = Move(Geometry=pln_phone_origin_2, Motion=vec_lens_location.Vector)  # -> Geometry, Transform
pln_phone_lens_origin = Plane(move.Geometry)
cir = Circle(Plane=pln_phone_lens_origin, Radius=phone_lens_radius)
crv_phone_lens_outline = Curve(cir)
pln_phone_lens_origin_2 = Plane(pln_phone_lens_origin)
neg_3 = Negative(Value=phone_lens_rim_offset)
Z = UnitZ(Factor=phone_lens_view_depth)
panel_11 = Panel(dom)
# notes: here we create a fustrum that more accurately reflects the camera view and what is seen on screen.
pln_phone_lens_origin_3 = Plane(pln_phone_lens_origin)
multiplication = Multiplication(A="9", B=num_fov)
# notes: with this we can set up a view to see what the camera will see while in the stand.  we can also test whether specific object will be in the field of view.
multiplication_2 = Multiplication(A="16", B=num_fov)
offset = OffsetCurve(Curve=crv_phone_lens_outline, Distance=neg_3, Corners=1)
rectangle = Rectangle(Plane=pln_table, XSize=domain_table_width, YSize=domain_table_length, Radius=0)  # -> Rectangle, Length
num_table_height_2 = Number(num_table_height)
multiplication_3 = Multiplication(A=phone_lens_view_depth, B=multiplication)
multiplication_4 = Multiplication(A=phone_lens_view_depth, B=multiplication_2)
merge = Merge(Data1=crv_phone_lens_outline, Data2=offset)  # -> flatten(Result)
panel_12 = Panel(pln_phone_lens_origin_2)
move_2 = Move(Geometry=pln_phone_lens_origin_3, Motion=Z)  # -> Geometry, Transform
boundary = BoundarySurfaces(Edges=rectangle.Rectangle)
num_x_size = Number(multiplication_3)
num_y_size = Number(multiplication_4)
boundary_2 = BoundarySurfaces(Edges=merge)
# notes: this creates a rectangle from the input of a plane, X dimension, and Y dimension.
phone_rectangle = Rectangle(Plane=pln_phone_origin, XSize=dom, YSize=num_phone_length, Radius=num_phone_corner_radius)  # -> Rectangle, Length
pln_phone_lens_origin_4 = Plane(move_2.Geometry)
Z_2 = UnitZ(Factor=num_table_height_2)
srf_table = Surface(boundary)
division_2 = Division(A=num_x_size, B="2.0")
srf_phone_lens_outline_surface = Surface(boundary_2)
division_3 = Division(A=num_y_size, B="2.0")
rectangle_length = Panel(phone_rectangle.Length)
neg_4 = Negative(Value=division_2)
neg_5 = Negative(Value=division_3)
Z_3 = UnitZ(Factor=phone_lens_thickness)
crv_phone_outline = Curve(phone_rectangle.Rectangle)
crv_phone_outline_2 = Curve(crv_phone_outline)
offset_2 = OffsetCurve(Curve=crv_phone_outline_2, Distance=neg_2, Corners=1)
panel_13 = Panel(offset_2)
crv = Curve(flatten(offset_2))
move_3 = Move(Geometry=srf_table, Motion=Z_2)  # -> Geometry, Transform
dom_2 = ConstructDomain(DomainStart=division_2, DomainEnd=neg_4)
dom_3 = ConstructDomain(DomainStart=division_3, DomainEnd=neg_5)
extr = Extrude(Base=srf_phone_lens_outline_surface, Direction=Z_3)
srf_table_2 = Surface(move_3.Geometry)
pln_phone_lens_origin_5 = Plane(pln_phone_lens_origin_2)
rev = Reverse(Vector=Z_2)
brep_phone_lens = Brep(extr)
rectangle_2 = Rectangle(Plane=pln_phone_lens_origin_4, XSize=dom_2, YSize=dom_3, Radius=0)  # -> Rectangle, Length
extr_2 = ExtrudePoint(Base=rectangle_2.Rectangle, Point=pln_phone_lens_origin_3)
extr_3 = Extrude(Base=srf_table_2, Direction=rev)
srf_table_3 = Surface(srf_table_2)
# notes: this creates a surface from the curve.  the input curve becomes the surface edge.
boundary_3 = BoundarySurfaces(Edges=crv_phone_outline)

num_phone_fit_tolerance_2 = Number(num_phone_fit_tolerance)
crv_phone_outline_3 = Curve(crv_phone_outline)
# Extrude phone with tolerance
num_phone_thickness_2 = Number(num_phone_thickness)
num_x_2_0 = Number(expr("x*2.0", num_phone_fit_tolerance_2))
offset_3 = OffsetCurve(Curve=crv_phone_outline_3, Distance=num_phone_fit_tolerance_2, Corners=1)  # -> flatten(Curve)
Z_4 = UnitZ(Factor=num_phone_fit_tolerance_2)
boundary_4 = BoundarySurfaces(Edges=offset_3)
addition = Addition(A=num_phone_thickness_2, B=num_x_2_0)
rev_2 = Reverse(Vector=Z_4)
srf_tolerance_phone_outline_surface = Surface(boundary_4)
Z_5 = UnitZ(Factor=addition)
srf_phone_outline_surface = Surface(boundary_3)
move_4 = Move(Geometry=srf_tolerance_phone_outline_surface, Motion=rev_2)  # -> Geometry, Transform
Z_6 = UnitZ(Factor=num_phone_thickness_2)
extr_4 = Extrude(Base=move_4.Geometry, Direction=Z_5)
extr_5 = Extrude(Base=srf_phone_outline_surface, Direction=Z_6)

cap = CapHoles(Brep=extr_2)
brep_table = Brep(extr_3)
num_camera35mmlenslength_2 = Number(num_camera35mmlenslength)
brep_phone_field_of_view_cone = Brep(cap)
srf_table_4 = Surface(srf_table_3)
txt_texture_path_student_transparency = Text(panel_9)
txt_texture_path_student = Text(panel_7)
txt_texture_path_floor = Text(panel_6)
txt_texture_path_desk = Text(panel_8)
txt_texture_path_student_transparency_2 = Text(txt_texture_path_student_transparency)
vec = Vector(Z_6)
txt_texture_path_student_2 = Text(txt_texture_path_student)
txt_texture_path_floor_2 = Text(txt_texture_path_floor)
txt_texture_path_desk_2 = Text(txt_texture_path_desk)
move_5 = Move(Geometry=crv, Motion=vec)  # -> Geometry, Transform
brep_phone = Brep(extr_5)
num_camera35mmlenslength_3 = Number(num_camera35mmlenslength_2)
brep_phone_field_of_view_cone_2 = Brep(brep_phone_field_of_view_cone)
srf_phone_outline_surface_2 = Surface(boundary_3)
brep_tolerance_phone = Brep(extr_4)
pln_phone_lens_origin_6 = Plane(pln_phone_lens_origin_5)
crv_phone_outline_4 = Curve(phone_rectangle.Rectangle)
crv_phone_screen = Curve(move_5.Geometry)
# MERGE ALL
pln_phone_origin_3 = Plane(xy_2)
brep_phone_lens_2 = Brep(brep_phone_lens)
brep_phone_2 = Brep(brep_phone)
map_dimension_mm = Slider(100, range=0..12000)
merge_phone_components = Merge(
    Data1=pln_phone_origin_3,
    Data2=crv_phone_outline_4,
    Data3=srf_phone_outline_surface_2,
    Data4=brep_phone_2,
    Data5=brep_phone_lens_2,
    Data6=pln_phone_lens_origin_6,
    Data7=brep_phone_field_of_view_cone_2,
    Data8=crv_phone_screen,
    Data9=brep_tolerance_phone)
geo_to_preview = Geometry(brep_table)
num_map_dimension = Number(map_dimension_mm)
table_x_coordinate = Slider(500, range=0..1000)
table_y_coordinate = Slider(500, range=0..1000)
srf_table_5 = Surface(srf_table_4)
geo_phone_components = Geometry(merge_phone_components)
cluster_4 = Cluster(num=num_map_dimension)
cluster_5 = Cluster_2(
    geo_to_preview=geo_to_preview,
    col_preview_diffuse_color=ColourSwatch(SwatchColor=RGB(209, 180, 134)),
    num_preview_transparency=Slider(0, range=0..1))
pt_2 = ConstructPoint(XCoordinate=table_x_coordinate, YCoordinate=table_y_coordinate, ZCoordinate=0)
brep_table_2 = Brep(brep_table)
box = CenterBox(Base=PlaneXY(0, 0, 0), X=cluster_4, Y=cluster_4, Z=cluster_4)
evalsrf = EvaluateSurface(Surface=srf_table_5, Point=pt_2)  # -> Point, Normal, UDirection, VDirection, Frame
pln_phone_location_on_table = Plane(evalsrf.Frame)
brep_table_3 = Brep(cluster_5)
brep_table_4 = Brep(brep_table_2)
item = ListItem(List=geo_phone_components, Index="0", Wrap=True)
boxmap = BoxMapping(Mesh=brep_table_2, Box=box)
txt_texture_path_desk_3 = Text(txt_texture_path_desk_2)
pt_phone_location_on_table = Point(pln_phone_location_on_table)
pln_phone_origin_4 = Plane(item)
viewing_angle = Slider(89, range=40..90)
phone_tolerance_mm_2 = Slider(0.2, range=0..2)
slot_thinkness = Slider(10, range=0..10)
distance = Slider(30, range=20..50)
lateral_support_extend = Slider(6, range=0..10)
cell_phone_stand_height = Slider(14, range=0..20)
material_thickness = Slider(5.36, range=3..10)
previewmat = CustomPreviewMaterials(Geometry=boxmap, DiffuseColor=RGB(255, 255, 255), DiffuseBitmap=txt_texture_path_desk_3)  # disabled
vec2pt = Vector2Pt(PointA=pln_phone_origin_4, PointB=pt_phone_location_on_table, Unitize=False)  # -> Vector, Length
move_6 = Move(Geometry=geo_phone_components, Motion=vec2pt.Vector)  # -> Geometry, Transform
# notes: move the phone to the surface of the table
move_7 = Move(Geometry=geo_phone_components, Motion=vec2pt.Vector)  # -> Geometry, Transform
num_phone_fit_tolerance_3 = Number(phone_tolerance_mm_2)
num_material_thickness = Number(material_thickness)
slot_distance = Number(distance)
slot_depth = Number(slot_thinkness)
geo_phone_components_2 = Geometry(move_7.Geometry)
num_phone_thickness_3 = Number(phone_thickness)
phone_length = Number(num_phone_length)
num_phone_viewing_angle = Number(viewing_angle)
# notes: rotate the phone to viewing position
phone_viewing_direction = Slider(0, range=0..360)
geo_phone_components_3 = Geometry(geo_phone_components_2)

addition_2 = Addition(A=num_phone_thickness_3, B="10")
division_4 = Division(A=phone_length, B=Slider(1.6, range=0.7..1.7))
Y = UnitY(Factor=division_4)
pt_3 = ConstructPoint(XCoordinate=0, YCoordinate=0, ZCoordinate=0)
move_8 = Move(Geometry=pt_3, Motion=Y)  # -> Geometry, Transform
X = UnitX(Factor=addition_2)
ln = Line(StartPoint=pt_3, EndPoint=move_8.Geometry)
# Zig Zag
neg_6 = Negative(Value=X)
move_9 = Move(Geometry=pt_3, Motion=neg_6)  # -> Geometry, Transform
move_10 = Move(Geometry=move_8.Geometry, Motion=X)  # -> Geometry, Transform
ln_2 = Line(StartPoint=move_10.Geometry, EndPoint=move_8.Geometry)
ln_3 = Line(StartPoint=move_9.Geometry, EndPoint=pt_3)
merge_2 = Merge(Data1=ln_3, Data2=ln_2, Data3=ln)

# ----
# Slot Position 2D
addition_3 = Addition(A=num_material_thickness, B=num_phone_fit_tolerance_3)
division_5 = Division(A=num_material_thickness, B=-2)
division_6 = Division(A=addition_3, B="2")
Y_2 = UnitY(Factor=division_5)
neg_7 = Negative(Value=division_6)
move_11 = Move(Geometry=pt_3, Motion=Y_2)  # -> Geometry, Transform
dom_4 = ConstructDomain(DomainStart=division_6, DomainEnd=neg_7)
len = Length(Curve=ln)
rectangle_3 = Rectangle(Plane=pt_3, XSize=slot_depth, YSize=dom_4, Radius=0)  # -> Rectangle, Length
division_7 = Division(A=len, B="4")
Y_3 = UnitY(Factor=division_7)
move_12 = Move(Geometry=rectangle_3.Rectangle, Motion=Y_3)  # -> Geometry, Transform
multiplication_5 = Multiplication(A=Y_3, B="2")
move_13 = Move(Geometry=move_12.Geometry, Motion=multiplication_5)  # -> Geometry, Transform
merge_3 = Merge(Data1=move_12.Geometry, Data2=move_13.Geometry)
rotate = Rotate(Geometry=merge_3, Angle=degrees(num_phone_viewing_angle), Plane=PlaneXY(0, 0, 0))  # -> Geometry, Transform

num_zero = Number(0)
item_2 = ListItem(List=geo_phone_components_3, Index="0", Wrap=True)
ln_4 = Line(StartPoint=pt_3, EndPoint=move_8.Geometry)
num_phone_viewing_direction = Number(num_zero)
pln_phone_origin_5 = Plane(item_2)
rotate_2 = Rotate(Geometry=geo_phone_components_3, Angle=degrees(num_phone_viewing_direction), Plane=pln_phone_origin_5)  # -> Geometry, Transform
geo_phone_components_4 = Geometry(rotate_2.Geometry)
geo_phone_components_5 = Geometry(geo_phone_components_4)
rotate_3 = Rotate(Geometry=merge_2, Angle=degrees(num_phone_viewing_angle), Plane=PlaneXY(0, 0, 0))  # -> Geometry, Transform

# ----
# base line
pt_4 = ConstructPoint(XCoordinate=0, YCoordinate=0, ZCoordinate=0)
Y_4 = UnitY(Factor="1000")
neg_8 = Negative(Value=Y_4)
move_14 = Move(Geometry=pt_4, Motion=Y_4)  # -> Geometry, Transform
move_15 = Move(Geometry=pt_4, Motion=neg_8)  # -> Geometry, Transform
ln_5 = Line(StartPoint=move_14.Geometry, EndPoint=move_15.Geometry)

# ----
# notes: rotate the phone to viewing position "up/down"
item_3 = ListItem(List=geo_phone_components_5, Index="0", Wrap=True)
pln_phone_origin_6 = Plane(item_3)
deplane = DeconstructPlane(Plane=pln_phone_origin_6)  # -> Origin, XAxis, YAxis, ZAxis
num_phone_viewing_angle_2 = Number(num_phone_viewing_angle)
line = LineSDL(Start=deplane.Origin, Direction=deplane.XAxis, Length=1)
rotax = RotateAxis(Geometry=geo_phone_components_5, Angle=degrees(num_phone_viewing_angle_2), Axis=line)  # -> Geometry, Transform
cell_phone_stand_height_2 = Number(cell_phone_stand_height)

panel_14 = Panel("""0
1""")
item_4 = ListItem(List=rotate_3.Geometry, Index=panel_14, Wrap=True)
end = EndPoints(Curve=item_4)  # -> Start, End
horizontal_points = Point(end.Start)
split = SplitList(List=horizontal_points, Index="1")  # -> ListA, ListB
X_2 = UnitX(Factor=1)
project = ProjectPoint(Point=horizontal_points, Direction=X_2, Geometry=ln_5)  # -> Point, Index
split_2 = SplitList(List=project.Point, Index="1")  # -> ListA, ListB
# HORIZONTAL
# DISTANCE
ln_6 = Line(StartPoint=split_2.ListA, EndPoint=split_2.ListB)
Y_5 = UnitY(Factor=cell_phone_stand_height_2)
offset_4 = OffsetCurve(Curve=ln_6, Distance=Y_5, Corners=1)

geo_phone_components_6 = Geometry(rotax.Geometry)
# notes: set the viewing orientation, "portrait/landscape"
portrait_landscape = ValueList({"portrait 0": "0", "landscape 90": "90", "portrait 180": "180", "landscape 270": "270"}, selected="landscape 90")
item_5 = ListItem(List=geo_phone_components_6, Index="0", Wrap=True)
item_6 = ListItem(List=geo_phone_components_6, Index="2", Wrap=True)
end_2 = EndPoints(Curve=offset_4)  # -> Start, End
srf_phone_outline_surface_3 = Surface(item_6)
pln_phone_origin_7 = Plane(item_5)
merge_4 = Merge(Data1=end_2.Start, Data2=end_2.End)
weave = Weave(Pattern=[0, 1], Stream0=graft(merge_4), Stream1=graft(horizontal_points), NullGaps=False)  # -> simplify(Weave)
area = Area(Geometry=srf_phone_outline_surface_3)  # -> Area, Centroid
num_phone_viewing_orientation = Number(portrait_landscape)
pl_origin = PlaneOrigin(Base=pln_phone_origin_7, Origin=area.Centroid)
split_3 = SplitList(List=weave, Index=1)  # -> ListA, ListB
ln_7 = Line(StartPoint=split_3.ListA, EndPoint=split_3.ListB)

# ----
# Cutting Plane
# Outline
len_2 = Length(Curve=ln_7)  # -> flatten(Length)
len_3 = Length(Curve=ln_6)
midpt = CurveMiddle(Curve=rotate_3.Geometry)
split_4 = SplitList(List=len_2, Index=1)  # -> ListA, ListB
addition_4 = Addition(A=split_4.ListA, B=split_4.ListB)
item_7 = ListItem(List=midpt, Index="2", Wrap=True)
vertical = Cluster(num=addition_4)
horizontal = Cluster(num=len_3)
pl = ConstructPlane(Origin=item_7, XAxis=Vector(1, 0, 0), YAxis=Vector(0, 1, 0))
rectangle_4 = Rectangle(Plane=pl, XSize=vertical, YSize=horizontal, Radius=0)  # -> Rectangle, Length

rotate_4 = Rotate(Geometry=geo_phone_components_6, Angle=degrees(num_phone_viewing_orientation), Plane=pl_origin)  # -> Geometry, Transform

# ----
# outline of one piece
horizontal_2 = Line(offset_4)
vertical_2 = Line(ln_7)
z_line = Line(rotate_3.Geometry)
join = JoinCurves(Curves=flatten([vertical_2, horizontal_2, z_line]), Preserve=False)
srf = Surface(join)

srf_2 = Surface(rectangle_4.Rectangle)
debrep = DeconstructBrep(Brep=srf_2)  # -> Faces, Edges, Vertices
pcen = PolygonCenter(Polyline=rectangle_4.Rectangle)  # -> CenterV, CenterE, CenterA
# notes: adjust phone location relative to table
phone_table_offset = Slider(-15, range=-50..50)
num_phone_viewing_orientation_2 = Number(num_phone_viewing_orientation)
geo_phone_components_7 = Geometry(rotate_4.Geometry)
item_8 = ListItem(List=debrep.Vertices, Index="1", Wrap=True)
Z_7 = UnitZ(Factor=phone_table_offset)
move_16 = Move(Geometry=geo_phone_components_7, Motion=Z_7)  # -> Geometry, Transform
geo_phone_components_8 = Geometry(move_16.Geometry)
geo_phone_components_9 = Geometry(geo_phone_components_8)
slot_distance_2 = Number(slot_distance)
num_phone_viewing_orientation_3 = Number(num_phone_viewing_orientation_2)
pln_phone_location_on_table_2 = Plane(pln_phone_location_on_table)
geo_phone_components_10 = Geometry(geo_phone_components_9)
num_camera35mmlenslength_4 = Number(num_camera35mmlenslength_3)
item_9 = ListItem(List=geo_phone_components_10, Index="3", Wrap=True)
item_10 = ListItem(List=geo_phone_components_10, Index="4", Wrap=True)
item_11 = ListItem(List=geo_phone_components_10, Index="6", Wrap=True)
item_12 = ListItem(List=geo_phone_components_10, Index="5", Wrap=True)
item_13 = ListItem(List=geo_phone_components_10, Index="7", Wrap=True)
pln_phone_lens_origin_7 = Plane(item_12)
num_camera35mmlenslength_5 = Number(num_camera35mmlenslength_4)
brep_phone_field_of_view_cone_3 = Brep(item_11)
crv_phone_screen_2 = Curve(item_13)
brep_phone_lens_3 = Brep(item_10)
brep_phone_3 = Brep(item_9)
brep_table_5 = Brep(brep_table_4)
shapein = ShapeInBrep(Brep=brep_phone_3, Shape=brep_table_5)
int_phone_in_table = Integer(shapein)
int_phone_in_table_2 = Integer(int_phone_in_table)
eval_2 = Evaluate(
    F="if(x=0,inside,if(x=1,intersecting,outside))",
    x=int_phone_in_table,
    inside=ColourSwatch(SwatchColor=RGB(255, 0, 0)),
    intersecting=ColourSwatch(SwatchColor=RGB(128, 208, 255)),
    outside=ColourSwatch(SwatchColor=RGB(0, 162, 255)))
center = Point(pcen.CenterV)
pt_5 = ConstructPoint(XCoordinate=0, YCoordinate=0, ZCoordinate=0)
X_3 = UnitX(Factor="1000")

# ----
# subline
panel_15 = Panel("2")
division_8 = Division(A=addition_2, B=panel_15)
offset_5 = OffsetCurve(Curve=ln, Distance=division_8, Corners=1)
rotate_5 = Rotate(Geometry=offset_5, Angle=degrees(num_phone_viewing_angle), Plane=PlaneXY(0, 0, 0))  # -> Geometry, Transform

# ----
# lateral support
two_slots = Geometry(rotate.Geometry)
material_thickness_with_tolerance = Number(addition_3)
lateral_support_extend_2 = Number(lateral_support_extend)
slot_distance_3 = Number(slot_distance)
addition_5 = Addition(A=material_thickness_with_tolerance, B=lateral_support_extend_2)
addition_6 = Addition(A=slot_distance_3, B=addition_5)
X_4 = UnitX(Factor=addition_6)

# ----
# stand in position
material_thickness_with_tolerance_2 = Number(addition_3)
brep_phone_4 = Brep(item_9)
Z_8 = UnitZ(Factor=material_thickness_with_tolerance_2)
extr_6 = Extrude(Base=srf, Direction=Z_8)
xz = XZPlane(Origin=Point(0, 0, 0))
debrep_2 = DeconstructBrep(Brep=brep_phone_4)  # -> Faces, Edges, Vertices
num_material_thickness_2 = Number(material_thickness)
rotate_6 = Rotate(Geometry=extr_6, Angle=degrees("-90"), Plane=xz)  # -> Geometry, Transform
item_14 = ListItem(List=debrep_2.Vertices, Index="7", Wrap=True)
division_9 = Division(A=num_material_thickness_2, B="-2")
X_5 = UnitX(Factor=division_9)
X_6 = UnitX(Factor=slot_distance_2)

neg_9 = Negative(Value=X_6)

rotate_7 = Rotate(Geometry=rotate_5.Geometry, Angle=degrees("-90"), Plane=xz)  # -> Geometry, Transform

rotate_8 = Rotate(Geometry=two_slots, Angle=degrees("-90"), Plane=xz)  # -> Geometry, Transform
volume = Volume(Geometry=brep_phone_4)  # -> Volume, Centroid
yz = YZPlane(Origin=volume.Centroid)

cp = PlaneClosestPoint(Point=item_14, Plane=yz)  # -> Point, UVPoint, Distance

move_17 = Move(Geometry=rotate_8.Geometry, Motion=cp.Point)  # -> Geometry, Transform
move_18 = Move(Geometry=move_17.Geometry, Motion=X_4)  # -> simplify(graft(Geometry)), Transform
mirror = MirrorSurface(Geometry=move_18.Geometry, Surface=yz, Frame=True)  # -> simplify(graft(Geometry))
loft = Loft(
    Curves=[move_18.Geometry, mirror],
    Options={Adjust=False, Closed=False, LoftEnds=0, LoftSimp=0, LoftType=0, Rebuild=10, Refit=0.01})
cap_2 = CapHoles(Brep=loft)  # -> flatten(Brep)

move_19 = Move(Geometry=cp.Point, Motion=X_5)  # -> Geometry, Transform
vec2pt_2 = Vector2Pt(PointA=pt_3, PointB=move_19.Geometry, Unitize=False)  # -> Vector, Length
move_20 = Move(Geometry=rotate_6.Geometry, Motion=vec2pt_2.Vector)  # -> Geometry, Transform
move_21 = Move(Geometry=move_20.Geometry, Motion=neg_9)  # -> Geometry, Transform
move_22 = Move(Geometry=move_20.Geometry, Motion=X_6)  # -> Geometry, Transform
vertical_part = Merge(Data1=move_22.Geometry, Data2=move_21.Geometry)

move_23 = Move(Geometry=rotate_7.Geometry, Motion=vec2pt_2.Vector)  # -> Geometry, Transform
move_24 = Move(Geometry=move_23.Geometry, Motion=X_6)  # -> Geometry, Transform
midpt_2 = CurveMiddle(Curve=move_24.Geometry)

# ----
# Lateral support with notches
item_15 = ListItem(List=move_17.Geometry, Index=0, Wrap=True)
explode = Explode(Curve=item_15, Recursive=True)  # -> Segments, Vertices
item_16 = ListItem(List=explode.Segments, Index=0, Wrap=True)
end_3 = EndPoints(Curve=item_16)  # -> Start, End
midpt_3 = CurveMiddle(Curve=item_16)
vec2pt_3 = Vector2Pt(PointA=end_3.End, PointB=midpt_3, Unitize=False)  # -> Vector, Length
move_25 = Move(Geometry=cap_2, Motion=vec2pt_3.Vector)  # -> Geometry, Transform
sdiff = SolidDifference(BrepsA=move_25.Geometry, BrepsB=vertical_part)
neg_10 = Negative(Value=vec2pt_3.Vector)
move_26 = Move(Geometry=sdiff, Motion=neg_10)  # -> Geometry, Transform

# ----
# stand with notches
debrep_3 = DeconstructBrep(Brep=move_22.Geometry)  # -> Faces, Edges, Vertices
item_17 = ListItem(List=debrep_3.Edges, Index="11", Wrap=True)
midpt_4 = CurveMiddle(Curve=item_17)
sdiff_2 = SolidDifference(BrepsA=vertical_part, BrepsB=move_25.Geometry)
item_18 = ListItem(List=sdiff_2, Index=0, Wrap=True)
item_19 = ListItem(List=move_26.Geometry, Index=0, Wrap=True)
volume_2 = Volume(Geometry=item_18)  # -> Volume, Centroid
volume_3 = Volume(Geometry=item_19)  # -> Volume, Centroid
yz_2 = YZPlane(Origin=volume_2.Centroid)
pl_2 = ConstructPlane(Origin=volume_3.Centroid, XAxis=Vector(1, 0, 0), YAxis=vec2pt_3.Vector)
orient = Orient(Geometry=item_19, Source=pl_2, Target=yz_2)  # -> Geometry, Transform
volume_4 = Volume(Geometry=orient.Geometry)  # -> Volume, Centroid
num_phone_viewing_angle_3 = Number(viewing_angle)
vec2pt_4 = Vector2Pt(PointA=volume_4.Centroid, PointB=midpt_4, Unitize=False)  # -> Vector, Length
move_27 = Move(Geometry=orient.Geometry, Motion=vec2pt_4.Vector)  # -> Geometry, Transform
yz_3 = YZPlane(Origin=midpt_4)
rotate_9 = Rotate(Geometry=move_27.Geometry, Angle=degrees(num_phone_viewing_angle_3), Plane=yz_3)  # -> Geometry, Transform
volume_5 = Volume(Geometry=rotate_9.Geometry)  # -> Volume, Centroid
midpoint = Point(midpt_2)
vec2pt_5 = Vector2Pt(PointA=volume_5.Centroid, PointB=midpoint, Unitize=False)  # -> Vector, Length
multiplication_6 = Multiplication(A=vec2pt_5.Vector, B="1.35")
move_28 = Move(Geometry=rotate_9.Geometry, Motion=multiplication_6)  # -> Geometry, Transform
xy_3 = XYPlane(Origin=midpoint)
scale_nu = ScaleNU(Geometry=move_28.Geometry, Plane=xy_3, ScaleX="20", ScaleY=1, ScaleZ=1)  # -> Geometry, Transform
sdiff_3 = SolidDifference(BrepsA=sdiff_2, BrepsB=scale_nu.Geometry)

item_20 = ListItem(List=sdiff_3, Index=0, Wrap=True)
debrep_4 = DeconstructBrep(Brep=item_20)  # -> Faces, Edges, Vertices
item_21 = ListItem(List=debrep_4.Vertices, Index="7", Wrap=True)

# ----
# move to table
pln_phone_location_on_table_3 = Plane(evalsrf.Frame)
merge_5 = Merge(Data1=sdiff_3, Data2=move_26.Geometry)
vec2pt_6 = Vector2Pt(PointA=item_21, PointB=pln_phone_location_on_table_3, Unitize=False)  # -> Vector, Length
merge_6 = Merge(Data1=brep_phone_3, Data2=brep_phone_lens_3, Data3=merge_5)
move_29 = Move(Geometry=merge_6, Motion=vec2pt_6.Vector)  # -> flatten(Geometry), Transform

item_22 = ListItem(List=debrep_4.Faces, Index="7", Wrap=True)
xz_2 = XZPlane(Origin=item_21)
rotate_10 = Rotate(Geometry=item_22, Angle=1.570796327, Plane=xz_2)  # -> Geometry, Transform
vec2pt_7 = Vector2Pt(PointA=item_21, PointB=item_8, Unitize=False)  # -> Vector, Length
edges = BrepEdges(Brep=rotate_10.Geometry)  # -> Naked, Interior, NonManifold
move_30 = Move(Geometry=edges.Naked, Motion=vec2pt_7.Vector)  # -> Geometry, Transform
rotate_11 = Rotate(Geometry=move_30.Geometry, Angle=degrees("180"), Plane=center)  # -> Geometry, Transform
merge_7 = Merge(Data1=move_30.Geometry, Data2=rotate_11.Geometry)
dupln = RemoveDuplicateLines(Lines=merge_7, Tolerance=0.01)
join_2 = JoinCurves(Curves=dupln, Preserve=False)
boundary_5 = BoundarySurfaces(Edges=join_2)
area_2 = Area(Geometry=boundary_5)  # -> Area, Centroid
vec2pt_8 = Vector2Pt(PointA=area_2.Centroid, PointB=pt_5, Unitize=False)  # -> Vector, Length
move_31 = Move(Geometry=join_2, Motion=vec2pt_8.Vector)  # -> Geometry, Transform
# BAKE ME!!!!!
move_32 = Move(Geometry=move_31.Geometry, Motion=X_3)  # -> Geometry, Transform
srf_3 = Surface(move_32.Geometry)  # disabled
preview = CustomPreview(Geometry=srf_3, Material=ColourSwatch(SwatchColor=RGB(157, 237, 226)))

# ----
# Display
panel_16 = Panel("""2
3
4
5""")
item_23 = ListItem(List=move_29.Geometry, Index=panel_16, Wrap=True)
item_24 = ListItem(List=move_29.Geometry, Index=0, Wrap=True)
item_25 = ListItem(List=move_29.Geometry, Index="1", Wrap=True)
material = CreateMaterial(
    Diffuse=ColourSwatch(SwatchColor=RGB(0, 90, 143)),
    Specular=RGB(255, 255, 255),
    Emission=RGB(0, 0, 0),
    Transparency=Slider(0, range=0..1),
    Shine=0)
material_2 = CreateMaterial(Diffuse=eval_2, Specular=RGB(255, 255, 255), Emission=RGB(0, 0, 0), Transparency=Slider(0.412, range=0..1), Shine=0)
preview_2 = CustomPreview(Geometry=item_24, Material=material_2)  # disabled
preview_3 = CustomPreview(Geometry=item_25, Material=material)  # disabled

material_3 = CreateMaterial(
    Diffuse=ColourSwatch(SwatchColor=RGB(171, 212, 110)),
    Specular=RGB(255, 255, 255),
    Emission=RGB(0, 0, 0),
    Transparency=Slider(0.365, range=0..1),
    Shine=0)

preview_4 = CustomPreview(Geometry=item_23, Material=material_3)  # disabled

# ==== cluster Cluster
num = ClusterInput()
num_2 = Number(num)
division = Division(A=num_2, B="2.0")
neg = Negative(Value=division)
dom = ConstructDomain(DomainStart=division, DomainEnd=neg)
domain = Domain(dom)
domain_2 = ClusterOutput(domain)

# ==== cluster Cluster_2
geo_to_preview = ClusterInput()
col_preview_diffuse_color = ClusterInput()
num_preview_transparency = ClusterInput()
geo_to_preview_2 = Geometry(geo_to_preview)
col_preview_diffuse_color_2 = Colour(col_preview_diffuse_color)
num_preview_transparency_2 = Number(num_preview_transparency)
material = CreateMaterial(
    Diffuse=col_preview_diffuse_color_2,
    Specular=RGB(255, 255, 255),
    Emission=RGB(0, 0, 0),
    Transparency=num_preview_transparency_2,
    Shine=0)
preview = CustomPreview(Geometry=geo_to_preview_2, Material=material)
geo_to_preview_3 = ClusterOutput(geo_to_preview_2)

# ==== cluster Cluster_3
num_camera35mmlenslength = ClusterInput()
# notes: these values were determined empirically. this equation may require adjestment depending on your setup.
num_camera35mmlenslength_2 = Number(num_camera35mmlenslength)
num = Number("2/30")
num_2 = Number("40")
multiplication = Multiplication(A=num_2, B=num)
division = Division(A=multiplication, B=num_camera35mmlenslength_2)
panel = Panel(division)
panel_2 = Panel(multiplication)
num_fov = Number(division)
num_fov_2 = ClusterOutput(num_fov)
